# Grasshopper definition Docofossor.gh (Grasshopper 1.0.7)
# plug-ins: Docofossor

# Lower "n", higher reso, slower process
number_slider = Slider(2, range=0..10)
file_path = FilePath()
number_slider_2 = Slider(2, range=0..10)
dfimportasc = ImportASC(F=file_path, N=number_slider)
input_gridsmooth = BooleanToggle(False)
input_gridfilter = BooleanToggle(False)
input_focusedregion = BooleanToggle(False)
pt = Point()
pt_2 = Point()
dfgridshift = GridShift(Df=dfimportasc)
Z = UnitZ(Factor=1)
crv = Curve()
file_path_2 = FilePath("C:\Users\loywe\OneDrive\Desktop\example_DTM.xyz")
number_slider_3 = Slider(11, range=0..100)
number_slider_4 = Slider(85, range=0..100)
pt_3 = Point(<point referenced from the Rhino model>)
srf = Surface(<surface referenced from the Rhino model>)
dfimportxyz = ImportXYZ(F=file_path_2, N=Slider(0, range=0..10))
crv_2 = Curve(<curve referenced from the Rhino model>)
dfgridshift_2 = GridShift(Df=dfimportxyz)
dffillinpoint = FillInPoint(Df=dfgridshift_2, Pt=pt_3, Sa=number_slider_3, D=number_slider_4)  # -> Df, Vol
crv_3 = Curve(<curve referenced from the Rhino model>)
dfcutinpoint = CutInPoint(Df=dfgridshift_2, Pt=pt_3, Sa=number_slider_3, D=number_slider_4)  # -> Df, Vol
dfcutfillinpath = CutFillInPath(Df=dfgridshift_2, Crv=crv_2, W=Slider(5, range=0..10), Sa=Slider(14, range=1..100), D=Slider(100, range=0..100))  # -> Df, Vol
dfcutfillinsurface = CutFillInSurface(Df=dfgridshift_2, Srf=srf, Sa=Slider(14, range=1..100), D=Slider(100, range=0..100))  # -> Df, Vol

# ---- group: base it here
dfgridmesh = GridMesh(Df=dfgridshift_2)

# ----
dfnoise = Noise(Df=dfcutfillinsurface.Df, Crv=crv_3, Wl=Slider(7, range=0..10), A=Slider(0, range=0..100), S=Slider(10, range=0..10))
dfgridmesh_2 = GridMesh(Df=dfcutfillinpath.Df)

# ---- group: base it here
dfgridmesh_3 = GridMesh(Df=dffillinpoint.Df)

# ----
preview = CustomPreview(Geometry=dfgridmesh, Material=ColourSwatch(SwatchColor=RGB(255, 255, 255)))
preview_2 = CustomPreview(Geometry=dfgridmesh_3, Material=ColourSwatch(SwatchColor=RGB(255, 255, 255)))
dfgridmesh_4 = GridMesh(Df=dfnoise)

# ---- group: For AnalysisPurposes
dfgridfilter = GridFilter(Df=dfgridshift, N=Slider(10, range=0..10))

# ----
filter = StreamFilter(Gate=input_gridfilter, Stream0=dfgridshift, Stream1=dfgridfilter)

# ---- group: For AnalysisPurposes (continued)
dfgridsmooth = GridSmooth(Df=filter, Rad=Slider(6, range=0..10))

# ----
dfshortestpath = ShortestPath(Df=dfgridsmooth, Sp=pt_2, Tp=pt)  # -> Dst, Pl
crv_4 = Curve(dfshortestpath.Pl)
panel = Panel(dfshortestpath.Dst)
filter_2 = StreamFilter(Gate=input_gridsmooth, Stream0=filter, Stream1=dfgridsmooth)
explode = Explode(Curve=crv_4, Recursive=True)  # -> Segments, Vertices
dfgridregion = GridRegion(Df=filter_2, Crv=crv)
filter_3 = StreamFilter(Gate=input_focusedregion, Stream0=filter_2, Stream1=dfgridregion)

# ---- group: DisplaySlopeVector
dfgridpoints = GridPoints(Df=dfgridsmooth)
dfslopevectors = SlopeVectors(Df=dfgridsmooth)
rev = Reverse(Vector=dfslopevectors)
vdis = VectorDisplay(Anchor=dfgridpoints, Vector=rev)

# ---- group: base it here
dfgridmesh_5 = GridMesh(Df=filter_3)

# ----
project = ProjectPoint(Point=explode.Vertices, Direction=Z, Geometry=dfgridmesh_5)  # -> Point, Index
pline = PolyLine(Vertices=project.Point, Closed=False)
preview_3 = CustomPreview(Geometry=dfgridmesh_5, Material=ColourSwatch(SwatchColor=RGB(255, 255, 255)))
