# Grasshopper definition GGG [Dec-22 '24, 1238].gh (Grasshopper 1.0.7)
# plug-ins: Docofossor, Heteroptera, Robots, GhPotrace [ShapeDiver Compatible Version], Pufferfish, HAL for Grasshopper

crv = Curve(<curve referenced from the Rhino model>)
number_slider = Slider(10, range=0..1000)
pt = Point([Point(230.506316, 523.6498012, 0), Point(230.506316, -4.596505673, 0), Point(809.7583212, -4.596505673, 0), Point(809.7583212, 523.6498012, 0)])
pline = PolyLine(Vertices=pt, Closed=Toggle(True))
pln = Plane(pline)
project = Project(Geometry=crv, Plane=pln)  # -> Geometry, Transform
pdecon = Deconstruct(Point=pt)  # -> XComponent, YComponent, ZComponent
bbox = BoundingBox(Content=project.Geometry, Plane=PlaneXY(0, 0, 0), UnionBox=True)  # -> Box, Box_2
srf = Surface(pline)
grid = GridInRectangle(Rectangle=pline, Size=number_slider, VSize=number_slider, FitSize=True)  # -> flatten(Points), U, V
avr = Average(Input=pdecon.ZComponent)
number_slider_2 = Slider(50, range=0..100)
rooster = Rooster(
    ImageBitmap=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,
    Threshold=50,
    CornerThreshold=1,
    MaxTurdArea=2,
    Optimize=True,
    Tolerance=0.2,
    Invert=False,
    ColorCount=2,
    RoosterOutputMode=False,
    RoosterTurnPolicy=0)  # -> Curves, Boundary, Colors
number_slider_3 = Slider(10, range=0..1000)
number_slider_4 = Slider(40, range=0..1000)
map_srf = MapToSurface(Curve=crv, Source=bbox.Box, Target=srf)
pt_2 = ConstructPoint(XCoordinate=0, YCoordinate=0, ZCoordinate=avr)
geo = Geometry(rooster.Boundary)
data = Data(rooster.Curves)
dfimportpoints = ImportPoints(Pts=grid.Points)
map_srf_2 = MapToSurface(Curve=data, Source=geo, Target=srf)
neg = Negative(Value=Slider(1, range=0..10))
Z = UnitZ(Factor=neg)
list = ValueList({"3D Printing": 0, "MSF": 1}, selected="3D Printing")
dffillinpath = FillInPath(Df=dfimportpoints, Crv=crv, Wt=number_slider_3, Sa=number_slider_2, D=number_slider_4)  # -> Df, Vol
dfcutinpath = CutInPath(Df=dfimportpoints, Crv=crv, Wb=number_slider_3, Sa=number_slider_2, D=number_slider_4)  # -> Df, Vol
move = Move(Geometry=map_srf_2, Motion=Z)  # -> Geometry, Transform
join = JoinCurves(Curves=move.Geometry, Preserve=False)
data_2 = Data(flatten(join))
divdist = DivideDistance(Curve=simplify(data_2), Distance=Slider(5, range=0..100))  # -> simplify(Points), Tangents, Parameters
geo_2 = Geometry([<brep referenced from the Rhino model> x2])
filter = StreamFilter(Gate=list, Stream0=dffillinpath.Df, Stream1=dfcutinpath.Df)
dfgridsmooth = GridSmooth(Df=filter, Rad=Slider(3, range=0..10))
xy = XYPlane(Origin=divdist.Points)
bbox_2 = BoundingBox(Content=geo_2, Plane=PlaneXY(0, 0, 0), UnionBox=False)  # -> Box, Box_2
bbox_3 = BoundingBox(Content=geo_2, Plane=PlaneXY(0, 0, 0), UnionBox=True)  # -> Box, Box_2
dfgridmesh = GridMesh(Df=dfgridsmooth)
box = EvaluateBox(Box=bbox_3.Box, UParameter=0.5, VParameter=0.5, WParameter=0.5)  # -> Plane, Point, Include
volume = Volume(Geometry=bbox_2.Box)  # -> Volume, Centroid
item = ListItem(List=xy, Index=0, Wrap=True)
contour = Contour(Shape=dfgridmesh, Point=pt_2, Direction=Vector(0, 0, 1), Distance=Slider(3, range=0..1000))  # -> simplify(Contours)
area = Area(Geometry=contour)  # -> Area, Centroid
Z_2 = UnitZ(Factor=Slider(20, range=0..100))
pdecon_2 = Deconstruct(Point=volume.Centroid)  # -> XComponent, YComponent, ZComponent
panel = Panel(divdist.Points)
pdecon_3 = Deconstruct(Point=area.Centroid)  # -> XComponent, YComponent, ZComponent
move_2 = Move(Geometry=item, Motion=Z_2)  # -> Geometry, Transform
bnd = Bounds(Numbers=pdecon_2.ZComponent)
equals = Equality(FirstNumber=pdecon_3.ZComponent, SecondNumber=avr)  # -> Equality, Inequality
dedomain = DeconstructDomain(Domain=bnd)  # -> Start, End
cull = CullPattern(List=pdecon_3.ZComponent, CullPattern=equals.Inequality)  # -> flatten(List)
cull_2 = CullPattern(List=contour, CullPattern=equals.Inequality)  # -> flatten(List)
merge = Merge(Data1=move_2.Geometry, Data2=xy, Data3=item, Data4=move_2.Geometry)  # -> flatten(Result)
equals_2 = Equality(FirstNumber=pdecon_2.ZComponent, SecondNumber=dedomain.End)  # -> Equality, Inequality
flippln = FlipPlane(Plane=merge, FlipX=False, FlipY=False, FlipZ=True)  # -> Flipped, R
sort = SortList(Keys=cull, ValuesA=cull_2)  # -> Keys, ValuesA
cull_3 = CullPattern(List=geo_2, CullPattern=equals_2.Equality)
crv_2 = Curve(sort.ValuesA)
debrep = DeconstructBrep(Brep=cull_3)  # -> Faces, Edges, Vertices
data_3 = Data(simplify(crv_2))
area_2 = Area(Geometry=debrep.Faces)  # -> Area, Centroid
divdist_2 = DivideDistance(Curve=crv_2, Distance=Slider(25, range=0..1000))  # -> Points, Tangents, simplify(Parameters)
list_2 = ValueList({"Joint", "Linear"}, selected="Linear")
list_3 = FlagFields({"Shoulder": 1, "Elbow": 2, "Wrist": 4}, selected="Shoulder")
speed = CreateSpeed(Translation=Slider(10, range=0..10), Rotation=3.141592654, ExternalTranslation=5000, ExternalRotation=18.84955592)
pdecon_4 = Deconstruct(Point=area_2.Centroid)  # -> XComponent, YComponent, ZComponent
crv_3 = Curve(graft(data_3))
bnd_2 = Bounds(Numbers=pdecon_4.ZComponent)
xy_2 = XYPlane(Origin=divdist_2.Points)
hframe = HorizontalFrame(Curve=crv_3, Parameter=divdist_2.Parameters)  # -> flatten(Frame)
dedomain_2 = DeconstructDomain(Domain=bnd_2)  # -> Start, End
list_4 = RobotsLibrary(
    {"ABB CRB15000-5", "ABB CRB15000-10", "ABB CRB15000-12", "UR3e", "UR5e", "UR10e", "UR16e", "UR3", "UR5", "UR10"}, selected="UR10",
    Type=0)
pflip = FlipPlane(Plane=xy_2, ReverseX=False, ReverseY=False, SwapAxes=True)  # -> simplify(Plane)
equals_3 = Equality(FirstNumber=pdecon_4.ZComponent, SecondNumber=dedomain_2.End)  # -> Equality, Inequality
loadrobot = LoadRobotSystem(Name=list_4, Base=PlaneXY(0, 0, 0))
item_2 = ListItem(List=pflip, Index=-1, Wrap=True)
cull_4 = CullPattern(List=debrep.Faces, CullPattern=equals_3.Equality)
item_3 = ListItem(List=pflip, Index=0, Wrap=True)
Z_3 = UnitZ(Factor="50")
data_4 = Data(flatten(item_2))
data_5 = Data(flatten(item_3))
brec = BoundingRectangle(Geometry=cull_4, Plane=PlaneXY(0, 0, 0), Axis=0, Slide=0, Union=True)  # -> Bounding, DimensionX, DimensionY
Z_4 = UnitZ(Factor="50")
pdecon_5 = Deconstruct(Point=data_4)  # -> XComponent, YComponent, ZComponent
srf_2 = Surface(reparameterize(brec.Bounding))
pdecon_6 = Deconstruct(Point=data_5)  # -> XComponent, YComponent, ZComponent
bnd_3 = Bounds(Numbers=pdecon_5.ZComponent)
debrep_2 = DeconstructBrep(Brep=cull_4)  # -> Faces, Edges, Vertices
bnd_4 = Bounds(Numbers=pdecon_6.ZComponent)
area_3 = Area(Geometry=simplify(srf_2))  # -> Area, Centroid
dedomain_3 = DeconstructDomain(Domain=bnd_3)  # -> Start, End
area_4 = Area(Geometry=debrep_2.Edges)  # -> Area, Centroid
dedomain_4 = DeconstructDomain(Domain=bnd_4)  # -> Start, End
number_slider_5 = Slider(28, range=0..100)
srf_cp = SurfaceClosestPoint(Point=area_3.Centroid, Surface=reparameterize(srf_2))  # -> Point, UVPoint, Distance
pt_3 = ConstructPoint(XCoordinate=0, YCoordinate=0, ZCoordinate=dedomain_3.End)
bnd_5 = Bounds(Numbers=area_4.Area)
pt_4 = ConstructPoint(XCoordinate=0, YCoordinate=0, ZCoordinate=dedomain_4.End)
xy_3 = XYPlane(Origin=pt_3)
evalsrf = EvaluateSurface(Surface=srf_2, Point=srf_cp.UVPoint)  # -> Point, Normal, UDirection, VDirection, Frame
dedomain_5 = DeconstructDomain(Domain=bnd_5)  # -> Start, End
xy_4 = XYPlane(Origin=pt_4)
number_slider_6 = Slider(8, range=0..10)
Z_5 = UnitZ(Factor=number_slider_5)
project_2 = Project(Geometry=item_2, Plane=xy_3)  # -> Geometry, Transform
equals_4 = Equality(FirstNumber=area_4.Area, SecondNumber=dedomain_5.Start)  # -> Equality, Inequality
project_3 = Project(Geometry=item_3, Plane=xy_4)  # -> Geometry, Transform
division = Division(A=number_slider_6, B=2)
move_3 = Move(Geometry=evalsrf.Frame, Motion=Z_5)  # -> Geometry, Transform
subtraction = Subtraction(A=number_slider_5, B=division)
cull_5 = CullPattern(List=debrep_2.Edges, CullPattern=equals_4.Equality)
move_4 = Move(Geometry=project_2.Geometry, Motion=Z_4)  # -> Geometry, Transform
move_5 = Move(Geometry=project_3.Geometry, Motion=Z_3)  # -> Geometry, Transform
Z_6 = UnitZ(Factor=division)
boundary = BoundarySurfaces(Edges=cull_5)
neg_2 = Negative(Value=Z_6)
Z_7 = UnitZ(Factor=subtraction)
merge_2 = Merge(Data1=move_5.Geometry, Data2=pflip, Data3=move_4.Geometry)
extr = Extrude(Base=boundary, Direction=Z_7)
data_6 = Data(geo_2)
move_6 = Move(Geometry=move_3.Geometry, Motion=neg_2)  # -> Geometry, Transform
sph = Sphere(Base=move_6.Geometry, Radius=expr("x/2", number_slider_6))
merge_3 = Merge(Data1=extr, Data2=sph)
sunion = SolidUnion(Breps=merge_3)
merge_4 = Merge(Data1=data_6, Data2=sunion)  # -> flatten(Result)
mesh = Mesh(merge_4)
mjoin = MeshJoin(Meshes=mesh)
tool = CreateTool(Name="MetalSheetFormingTool", TCP=move_3.Geometry, Weight=Slider(0.3, range=0.1..10), Centroid=box.Point, Mesh=mjoin)  # -> Tool, TCP
tool_2 = ToolParameter(tool.Tool)
target = CreateTarget(Plane=flatten(flippln.Flipped), RobConf=list_3, Motion=list_2, Tool=tool_2, Speed=speed, IsCartesian=True)
program = CreateProgram(Name="DefaultProgram", RobotSystem=loadrobot, Targets=target, StepSize=1)  # -> Program, Code, Duration, Warnings, Errors
sim = ProgramSimulation(Program=program.Program, Time=Slider(0, range=0..1), Normalized=True)  # -> SystemMeshes, JointRotations, Plane, Index, Time, Program, Errors
target_2 = CreateTarget(Plane=flatten(merge_2), Tool=tool_2, IsCartesian=True)
rev = ReverseList(List=target_2)
filter_2 = StreamFilter(Gate=list, Stream0=target_2, Stream1=rev)
program_2 = CreateProgram(Name="DefaultProgram", RobotSystem=loadrobot, Targets=filter_2, StepSize=1)  # -> Program, Code, Duration, Warnings, Errors
sim_2 = ProgramSimulation(Program=program_2.Program, Time=Slider(0, range=0..1), Normalized=True)  # -> SystemMeshes, JointRotations, Plane, Index, Time, Program, Errors
session_settings = SessionSettings()
