# Grasshopper definition Sketching With Rooster.gh (Grasshopper 1.0.7)
# plug-ins: HAL for Grasshopper, Robots, GhPotrace [ShapeDiver Compatible Version], G E N E R A T I O N

input_zoneradius_mm = Slider(1, range=0..1)
list = ValueList({"Joint", "Linear"}, selected="Joint")
input_penciltipoffsetdistance_mm = Slider(30, range=0..100)
list_2 = FlagFields({"Shoulder": 1, "Elbow": 2, "Wrist": 4}, selected=[])

# ----
# LOY'S OPEN SOURCE
# MAIN FUNCTION
# USER INPUTS
# AUTOMATIC INPUTS
# PROCESSING FUNCTIONS
# HELPERS
# TIP: If you are not sure where anything is just CTRL + ALT + Left Click.
# READ ME
# Package(s) Needed: Fologram (https://fologram.com/download)
# Robot (https://www.food4rhino.com/en/app/robots ) - )
# Note(s): 1. Make sure the Rhino project is in "mm".
# 3. Connect to the same network as the robots.
# Tested In: 190624_In Rhino 7_weiwin.loy@hdr.qut.edu.au.
# Network Connection: Account: ARM Hub Automate
# Password: Arm#hub2
# Changes: Cleaning and Revising color error correction etc
robotic_arm_ip_address = Panel("192.168.1.39")

input_robotmotion = Data(list)
input_robotconfig = Data(list_2)
speed = CreateSpeed(
    Translation=Slider(100, range=0..100),
    Rotation=3.141592654,
    ExternalTranslation=5000,
    ExternalRotation=18.84955592,
    AccelTranslation=2500,
    AccelAxis=12.56637061)
input_robottool = Geometry([<mesh referenced from the Rhino model> x2])
input_zoneradius_mm_2 = Data(input_zoneradius_mm)
speed_2 = SpeedParameter(speed)
rooster = Rooster(
    ImageBitmap=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,
    Threshold=50,
    CornerThreshold=1,
    MaxTurdArea=2,
    Optimize=True,
    Tolerance=0.2,
    Invert=False,
    ColorCount=2,
    RoosterOutputMode=False,
    RoosterTurnPolicy=0)  # -> Curves, Boundary, Colors
input_penciltipoffsetdistance_mm_2 = Data(input_penciltipoffsetdistance_mm)
input_offsetdistancefromcanvas_mm = Data(Slider(20, range=0..100))
input_resolution_distancebetweenpoints_m = Data(Slider(3, range=2..10))  # "INPUT_Resolution_DistanceBetweenPoints_mm"
input_registeredcrvs = Data(rooster.Curves)
input_registeredboundary = Data(rooster.Boundary)
cluster = Cluster_2(input_robottool=input_robottool, input_penciltipoffsetdistance_mm=input_penciltipoffsetdistance_mm_2)

geo = Geometry([<brep referenced from the Rhino model> x3])
bbox = BoundingBox(Content=geo, Plane=PlaneXY(0, 0, 0), UnionBox=True)  # -> Box, Box_2
debrep = DeconstructBrep(Brep=bbox.Box)  # -> Faces, Edges, Vertices
box = EvaluateBox(Box=bbox.Box, UParameter=0.5, VParameter=0.5, WParameter=1)  # -> Plane, Point, Include
area = Area(Geometry=debrep.Faces)  # -> Area, Centroid
dist = Distance(PointA=box.Plane, PointB=area.Centroid)
round = Round(Number=dist)  # -> Nearest, Floor, Ceiling
equals = Equality(FirstNumber=round.Floor, SecondNumber=0)  # -> Equality, Inequality
cull = CullPattern(List=debrep.Faces, CullPattern=equals.Equality)

cluster_2 = Cluster_3(
    input_registeredcrvs=input_registeredcrvs,
    input_registeredboundary=input_registeredboundary,
    input_mappedsurface=cull,
    input_resolution_distancebetweenpoints_m=input_resolution_distancebetweenpoints_m,
    input_offsetdistancefromcanvas_mm=input_offsetdistancefromcanvas_mm)

list_3 = RobotsLibrary(
    {"ABB CRB15000-5", "ABB CRB15000-10", "ABB CRB15000-12", "UR3e", "UR5e", "UR10e", "UR16e", "UR3", "UR5", "UR10"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}, selected="UR10",
    Type=0)
loadrobot = LoadRobotSystem(Name=list_3, Base=PlaneXY(0, 0, 0))
robotsystem = RobotSystemParameter(loadrobot)

input_robotspeed = SpeedParameter(speed_2)
output_illustrations_pln = Data(cluster_2)
input_robotconfig_2 = Data(input_robotconfig)
input_robotmotion_2 = Data(input_robotmotion)
output_robottool = ToolParameter(cluster)
input_zoneradius_mm_3 = Data(input_zoneradius_mm_2)
pflip = FlipPlane(Plane=output_illustrations_pln, ReverseX=False, ReverseY=False, SwapAxes=True)
target = CreateTarget(
    Plane=pflip,
    RobConf=input_robotconfig_2,
    Motion=input_robotmotion_2,
    Tool=output_robottool,
    Speed=input_robotspeed,
    Zone=input_zoneradius_mm_3,
    IsCartesian=True)
output_robottargets = TargetParameter(target)

robotsystem_2 = RobotSystemParameter(robotsystem)
target_2 = TargetParameter(output_robottargets)
program = CreateProgram(Name="LOYSketching", RobotSystem=robotsystem_2, Targets=target_2, StepSize=1)  # -> Program, Code, Duration, Warnings, Errors

# ----
# UI / OUTPUTS
trigger = Trigger(Interval=100, TimerInterval=100, Target=count)
count = Counter(Start=0, Step=0.005, Pause=Button(), Reset=Button())
program_2 = ProgramParameter(program.Program)
sim = ProgramSimulation(Program=program_2, Time=count, Normalized=invert(True))  # -> SystemMeshes, JointRotations, Plane, Index, Time, Program, Errors

panel = Panel(program.Warnings)
cluster_3 = Cluster(G=sim.SystemMeshes, L=sim.Plane, P=sim.Program)
session_settings = SessionSettings()

# ==== cluster Cluster
L = ClusterInput()
P = ClusterInput()
item = ListItem(List=L, Index=-1, Wrap=True)
swatch = ColourSwatch(SwatchColor=RGBA(255, 255, 255, 104))
G = ClusterInput()
trail = SimpleTrail(Program=P, Length=1000000, MechanicalGroup=0)
msphere = MeshSphere(Base=item, Radius=10, UCount=10, VCount=20)
preview = CustomPreview(Geometry=G, Material=swatch)
preview_2 = CustomPreview(Geometry=trail, Material=swatch)
preview_3 = CustomPreview(Geometry=msphere, Material=swatch)

# ==== cluster Cluster_2
input_robottool = ClusterInput()
input_penciltipoffsetdistance_mm = ClusterInput()
input_penciltipoffsetdistance_mm_2 = Data(input_penciltipoffsetdistance_mm)
input_robottool_2 = Mesh(input_robottool)
mjoin = MeshJoin(Meshes=input_robottool_2)
bbox = BoundingBox(Content=mjoin, Plane=PlaneXY(0, 0, 0))  # -> Box, Box_2
Z = UnitZ(Factor=input_penciltipoffsetdistance_mm_2)
box = EvaluateBox(Box=bbox.Box, UParameter=0.5, VParameter=0.5, WParameter=1)  # -> Plane, Point, Include
move = Move(Geometry=box.Plane, Motion=Z)  # -> Geometry, Transform
tool = CreateTool(Name="DefaultGHTool", TCP=move.Geometry, Weight=0, Mesh=mjoin)  # -> Tool, TCP
output_robottool = ToolParameter(tool.Tool)
output_robottool_2 = ClusterOutput(output_robottool)

# ==== cluster Cluster_3
input_mappedsurface = ClusterInput()
input_registeredcrvs = ClusterInput()
input_registeredboundary = ClusterInput()
input_resolution_distancebetweenpoints_m = ClusterInput()  # "INPUT_Resolution_DistanceBetweenPoints_mm"
input_offsetdistancefromcanvas_mm = ClusterInput()
input_registeredcrvs_2 = Data(input_registeredcrvs)
input_mappedsurface_2 = Geometry(input_mappedsurface)
input_registeredboundary_2 = Data(input_registeredboundary)
input_resolution_distancebetweenpoints_m_2 = Data(input_resolution_distancebetweenpoints_m)  # "INPUT_Resolution_DistanceBetweenPoints_mm"
input_offsetdistancefromcanvas_mm_2 = Data(input_offsetdistancefromcanvas_mm)
map_srf = MapToSurface(Curve=input_registeredcrvs_2, Source=input_registeredboundary_2, Target=input_mappedsurface_2)
join = JoinCurves(Curves=map_srf, Preserve=False)
Z = UnitZ(Factor=input_offsetdistancefromcanvas_mm_2)
simplify = SimplifyCurve(Curve=join)  # -> simplify(Curve), Simplified
python = GhPythonScript(INPUT_UnsortedCrv_Crv=simplify.Curve)  # -> out, OUTPUT_SortedCurves; inputs INPUT_UnsortedCrv_Crv: list of Curve
# ---------- python: Python ----------
import rhinoscriptsyntax as rs
import Rhino.Geometry as rg

# Input parameter: List of curves
# Make sure you set the input 'curves' type hint to 'List Access' in the Grasshopper component
input_curves = INPUT_UnsortedCrv_Crv

# Initialize the output list
culled_curves = []

# Function to find the closest curve to a given point
def find_closest_curve(point, curves):
    min_distance = float('inf')
    closest_curve = None
    for crv in curves:
        start_point = crv.PointAtStart
        distance = point.DistanceTo(start_point)
        if distance < min_distance:
            min_distance = distance
            closest_curve = crv
    return closest_curve

# Check if there are curves to process
if input_curves:
    # Start with the first curve
    current_curve = input_curves[0]
    culled_curves.append(current_curve)
    input_curves.remove(current_curve)

    # Iterative process to find and remove the closest curve
    while input_curves:
        # Get the end point of the current curve
        end_point = current_curve.PointAtEnd
        
        # Find the closest curve to the end point
        closest_curve = find_closest_curve(end_point, input_curves)
        
        if closest_curve is None:
            break

        # Add the closest curve to the culled curves list
        culled_curves.append(closest_curve)
        
        # Remove the closest curve from the input list
        input_curves.remove(closest_curve)
        
        # Update the current curve
        current_curve = closest_curve

# Output the culled curves
OUTPUT_SortedCurves = culled_curves
# ---------- end python ----------
divlength = DivideLength(Curve=python.OUTPUT_SortedCurves, Length=input_resolution_distancebetweenpoints_m_2)  # -> simplify(Points), Tangents, Parameters
item = ListItem(List=divlength.Points, Index=0, Wrap=True)
move = Move(Geometry=item, Motion=Z)  # -> Geometry, Transform
merge = Merge(Data1=move.Geometry, Data2=divlength.Points, Data3=item, Data4=move.Geometry)  # -> flatten(Result)
xy = XYPlane(Origin=merge)
output_illustrations_pln = Data(xy)
output_illustrations_pln_2 = ClusterOutput(output_illustrations_pln)
