# Grasshopper definition rr.gh (Grasshopper 1.0.7)
# plug-ins: GhPotrace [ShapeDiver Compatible Version], Robots, Pufferfish, Fologram for Grasshopper

input_robotspeed_mm_s = Slider(5, range=0..10)

list = ValueList({"Joint", "Linear"}, selected="Linear")
input_robotmotion = Data(list)

list_2 = RobotsLibrary({"UR3e", "UR5e", "UR10e", "UR16e", "UR3", "UR5", "UR10"}, selected="UR5", Type=0)

input_robotzone = Slider(5, range=0..10)
input_robotzone_2 = Data(input_robotzone)

# ----
# Package(s) Needed: Fologram (https://fologram.com/download)
# Robot (https://www.food4rhino.com/en/app/robots )
# Ladybug (for false start)
# Bengesht (https://www.food4rhino.com/en/app/bengesht)
# READ ME
# Note(s): 1. Make sure the Rhino project is in "mm".
# 3. Connect to the same network as the robots.
# Tested In: 231004_In Rhino 7_weiwin.loy@hdr.qut.edu.au.
# Network Connection: Account: ARM Hub Automate
# Password: Arm#hub2
int_gumballlength_mm = Slider(50, range=0..100)
int_fontsize = Slider(15, range=0..100)
int_offsetfrompoint_mm = Slider(15, range=0..20)
int_offsetfrompoint_02_mm = Slider(30, range=0..100)
int_gumballlength = Data(int_gumballlength_mm)
int_pointoffset = Data(int_offsetfrompoint_mm)
int_txtoffset = Data(int_offsetfrompoint_02_mm)
int_fontsize_2 = Data(int_fontsize)

input_weight_kg = Slider(4, range=0..10)
input_robottype = Data(list_2)
input_weight_kg_2 = Data(input_weight_kg)
input_robotspeed_mm_s_2 = Data(input_robotspeed_mm_s)

input_robotspeed_mm_s_3 = Data(input_robotspeed_mm_s_2)

input_robottype_2 = Data(input_robottype)

list_3 = FlagFields({"Shoulder": 1, "Elbow": 2, "Wrist": 4}, selected="Shoulder")

# ---- group: SET COORDINATE AS 0,0,0, XY PLANE
# USER INPUTS
# WORLD AND ROBOT COORDINATE FRAME
# 01
# ASSUMPTION: Assuming the robot is hosted on a horizontal (XY) platform. World Coordinate Frame (WFC) and Robot Coordinate Frame (RCF) is equal
panel = Panel("0")
pt = ConstructPoint(XCoordinate=panel, YCoordinate=panel, ZCoordinate=panel)
# DESIGN LABS
# AUTOMATIC INPUTS
# Establish robot base point
xy = XYPlane(Origin=Point(0, 0, 0))
pl_origin = PlaneOrigin(Base=xy, Origin=pt)
# PROCESSING FUNCTIONS
# HELPERS
# Visualise in Fologram
output_originplane_robot_base = Plane(pl_origin)

# ----
loadrobot = LoadRobotSystem(Name=input_robottype_2, Base=PlaneXY(0, 0, 0))
input_robottype_3 = Data(loadrobot)

speed = CreateSpeed(Translation=input_robotspeed_mm_s_3, Rotation=3.141592654, ExternalTranslation=5000, ExternalRotation=18.84955592)
input_robotspeed_mm_s_4 = Data(speed)

xy_2 = XYPlane(Origin=Point(0, 0, 0))
Z = UnitZ(Factor=Slider(114, range=0..1000))
move = Move(Geometry=xy_2, Motion=Z)  # -> Geometry, Transform
ln = Line(StartPoint=xy_2, EndPoint=move.Geometry)
pipe = Pipe(Curve=ln, Radius=5, Caps=0)
input_weight_kg_3 = Data(input_weight_kg_2)
cap = CapHoles(Brep=pipe)
volume = Volume(Geometry=cap)  # -> Volume, Centroid
tool = CreateTool(Name="DefaultGHTool", TCP=move.Geometry, Weight=input_weight_kg_3, Centroid=volume.Centroid, Mesh=cap)  # -> Tool, TCP
input_robottool = Data(tool.Tool)

# ----
# WORKFLOW: Right click on "Bitmap" and set one grasshopper bitmap.
number_slider = Slider(10, range=0..100)

# ----
# MAIN FUNCTION
# UI / OUTPUTS
rooster = Rooster(
    ImageBitmap=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,
    Threshold=number_slider,
    CornerThreshold=1,
    MaxTurdArea=2,
    Optimize=True,
    Tolerance=Slider(1, range=0..1),
    Invert=Toggle(False),
    ColorCount=Slider(2, range=1..15),
    RoosterOutputMode=True,
    RoosterTurnPolicy=0)  # -> Curves, Boundary, Colors
output_drawing = Data(rooster.Curves)

dispatch = Dispatch(DispatchPattern=[True, False])  # -> ListA, ListB
vec = VectorXYZ(XComponent=Slider(0, range=0..1000), YComponent=Slider(0, range=0..1000), ZComponent=Slider(100, range=0..100))  # -> Vector, Length
interaction = InteractionType(15)
srf = Surface(<surface referenced from the Rhino model>)
sync = SyncGeometry(Geometry=srf, Interactions=interaction)
move_2 = Move(Geometry=srf, Motion=sync)  # -> Geometry, Transform
edges = BrepEdges(Brep=move_2.Geometry)  # -> Naked, Interior, NonManifold
join = JoinCurves(Curves=edges.Naked, Preserve=False)
debrep = DeconstructBrep(Brep=join)  # -> Faces, Edges, Vertices
midpt = CurveMiddle(Curve=debrep.Edges)
len = Length(Curve=debrep.Edges)
pln = Plane(debrep.Faces)
pdecon = Deconstruct(Point=midpt)  # -> XComponent, YComponent, ZComponent
bnd = Bounds(Numbers=len)
pln_2 = Plane(pln)
area = Area(Geometry=debrep.Faces)  # -> Area, Centroid
dedomain = DeconstructDomain(Domain=bnd)  # -> Start, End
equals = Equality(FirstNumber=len, SecondNumber=dedomain.End)  # -> Equality, Inequality
cull = CullPattern(List=debrep.Edges, CullPattern=equals.Equality)
len_2 = Length(Curve=cull)  # -> flatten(Length)
avr = Average(Input=len_2)
item = ListItem(List=cull, Index=0, Wrap=True)
pln_3 = Plane(move_2.Geometry)
midpt_2 = CurveMiddle(Curve=item)
pl_origin_2 = PlaneOrigin(Base=pln_2, Origin=area.Centroid)
panel_2 = Panel(len_2)
pl_origin_3 = PlaneOrigin(Base=pln, Origin=midpt_2)

input_robottype_4 = Data(input_robottype_3)

input_robotmotion_2 = Data(input_robotmotion)
input_robottool_2 = Data(input_robottool)
input_robotspeed_mm_s_5 = Data(input_robotspeed_mm_s_4)
input_robotzone_3 = Data(input_robotzone_2)

output_drawing_2 = Data(output_drawing)
join_2 = JoinCurves(Curves=output_drawing_2, Preserve=False)  # -> simplify(Curves)

lng = ListLength(List=join_2)  # -> flatten(Length)
item_2 = ListItem(List=lng, Index=0, Wrap=True)
data = Data(flatten(join_2))
split = SplitList(List=data, Index=item_2)  # -> ListA, ListB

brec = BoundingRectangle(Geometry=split.ListA, Plane=PlaneXY(0, 0, 0), Axis=0, Slide=0, Union=True)  # -> flatten(Bounding), DimensionX, DimensionY
area_2 = Area(Geometry=brec.Bounding)  # -> Area, Centroid
bnd_2 = Bounds(Numbers=area_2.Area)
dedomain_2 = DeconstructDomain(Domain=bnd_2)  # -> Start, End
equals_2 = Equality(FirstNumber=dedomain_2.End, SecondNumber=area_2.Area)  # -> Equality, Inequality
cull_2 = CullPattern(List=brec.Bounding, CullPattern=equals_2.Equality)

panel_3 = Panel(lng)
panel_4 = Panel(join_2)

area_3 = Area(Geometry=cull_2)  # -> Area, Centroid
scale = Scale(Geometry=cull_2, Center=area_3.Centroid, Factor=Slider(0.5, range=0..1))  # -> Geometry, Transform

map_srf = MapToSurface(Curve=split.ListA, Source=cull_2, Target=scale.Geometry)
move_3 = Move(Geometry=scale.Geometry, Motion=vec.Vector)  # -> Geometry, Transform
move_4 = Move(Geometry=map_srf, Motion=Vector(0, 0, 10))  # -> Geometry, Transform

pln_4 = Plane(scale.Geometry)

move_5 = Move(Geometry=pln_4, Motion=vec.Vector)  # -> Geometry, Transform

deplane = DeconstructPlane(Plane=move_5.Geometry)  # -> Origin, XAxis, YAxis, ZAxis
rot3d = Rotate3D(Geometry=move_3.Geometry, Angle=degrees(Slider(0, range=0..360)), Center=move_5.Geometry, Axis=deplane.XAxis)  # -> Geometry, Transform

debrep_2 = DeconstructBrep(Brep=rot3d.Geometry)  # -> Faces, Edges, Vertices
len_3 = Length(Curve=debrep_2.Edges)
bnd_3 = Bounds(Numbers=len_3)
dedomain_3 = DeconstructDomain(Domain=flatten(bnd_3))  # -> Start, End
panel_5 = Panel(dedomain_3.End)
division = Division(A=avr, B=dedomain_3.End)
scale_2 = Scale(Geometry=move_4.Geometry, Center=Point(0, 0, 0), Factor=division)  # -> Geometry, Transform
brec_2 = BoundingRectangle(Geometry=scale_2.Geometry, Plane=PlaneXY(0, 0, 0), Axis=0, Slide=0, Union=True)  # -> Bounding, DimensionX, DimensionY
pln_5 = Plane(brec_2.Bounding)
area_4 = Area(Geometry=brec_2.Bounding)  # -> Area, Centroid
pl_origin_4 = PlaneOrigin(Base=pln_5, Origin=area_4.Centroid)
orient = Orient(Geometry=scale_2.Geometry, Source=pl_origin_4, Target=pl_origin_2)  # -> Geometry, Transform
divdist = DivideDistance(Curve=flatten(orient.Geometry), Distance=Slider(1, range=0..10))  # -> simplify(Points), Tangents, Parameters
pl_origin_5 = PlaneOrigin(Base=simplify(pl_origin_2), Origin=divdist.Points)  # -> simplify(Plane)
input_targetplane = Data(pl_origin_5)
flippln = FlipPlane(Plane=input_targetplane, FlipX=False, FlipY=False, FlipZ=True)  # -> Flipped, R

input_targetplane_2 = Data(flippln.Flipped)
item_3 = ListItem(List=input_targetplane_2, Index=0, Wrap=True)
pl_offset = PlaneOffset(BasePlane=item_3, Offset="-5")
merge = Merge(Data1=pl_offset, Data2=input_targetplane_2, Data3=item_3, Data4=pl_offset)  # -> flatten(Result)
input_pln_robottarget = Data(merge)

input_pln_robottarget_2 = Data(input_pln_robottarget)

target = CreateTarget(
    Plane=flatten(input_pln_robottarget_2),
    RobConf=list_3,
    Motion=input_robotmotion_2,
    Tool=input_robottool_2,
    Speed=input_robotspeed_mm_s_5,
    Zone=input_robotzone_3,
    IsCartesian=True)
input_robottarget = Data(target)

input_robottarget_2 = Data(input_robottarget)

split_2 = SplitList(List=input_robottarget_2, Index=Slider(1000, range=0..1000))  # -> ListA, ListB

program = CreateProgram(Name="DefaultProgram", RobotSystem=input_robottype_4, Targets=split_2.ListA, StepSize=1)  # -> Program, Code, Duration, Warnings, Errors
output_developedprogram = Data(program.Program)

output_developedprogram_2 = Data(output_developedprogram)

sim = ProgramSimulation(Program=output_developedprogram_2, Time=0, Normalized=True)  # -> SystemMeshes, JointRotations, Plane, Index, Time, Program, Errors
output_processedprogram = Data(sim.Program)

output_processedprogram_2 = Data(output_processedprogram)

trail = SimpleTrail(Program=output_processedprogram_2, Length=1000000, MechanicalGroup=0)
output_robottoolpath = Data(trail)

remote = RemoteConnection(
    Program=flatten(output_developedprogram),
    IP="192.168.3.98",
    Upload=Toggle(True),
    Play=Toggle(False),
    Pause=Toggle(False))
panel_6 = Panel(remote)
pline = PolyLine(Vertices=input_targetplane_2, Closed=False)
sync_2 = SyncGeometry(Geometry=pline)
