# Grasshopper definition sOMETHING TO THINK ABOUT.gh (Grasshopper 1.0.7)
# plug-ins: Robots

list = RobotsLibrary({"UR3e", "UR5e", "UR10e", "UR16e", "UR3", "UR5", "UR10"}, selected="UR5", Type=0)
panel = Panel("""90
-90
-90
-90
90
0""")
loadrobot = LoadRobotSystem(Name=list, Base=PlaneXY(0, 0, 0))
degtorad = DegreesToRadians(Degrees=panel, RobotSystem=loadrobot, MechanicalGroup=0)
target = CreateTarget(Joints=degtorad, IsCartesian=False)
K = Kinematics(RobotSystem=loadrobot, Target=target, DisplayGeometry=Slider(1, range=0..1))  # -> Meshes, Joints, Planes, Errors
item = ListItem(List=K.Planes, Index=-1, Wrap=True)
vec = VectorXYZ(XComponent=Slider(57, range=0..100), YComponent=Slider(16, range=0..100), ZComponent=Slider(-251, range=-500..0))  # -> Vector, Length
list_2 = FlagFields({"Shoulder": 1, "Elbow": 2, "Wrist": 4}, selected="Shoulder")
move = Move(Geometry=item, Motion=vec.Vector)  # -> Geometry, Transform
target_2 = CreateTarget(Plane=move.Geometry, RobConf=list_2, IsCartesian=True)
program = CreateProgram(Name="DefaultProgram", RobotSystem=loadrobot, Targets=target_2, StepSize=1)  # -> Program, Code, Duration, Warnings, Errors
remote = RemoteConnection(Program=program.Program, IP="192.168.3.98", Upload=Toggle(True), Play=Toggle(False), Pause=Toggle(False))
panel_2 = Panel(remote)
K_2 = Kinematics(RobotSystem=loadrobot, Target=target_2, DisplayGeometry=Slider(1, range=0..1))  # -> Meshes, Joints, Planes, Errors
subtraction = Subtraction(A="180.86", B=Slider(21.9, range=0..100))
